% Simulink data dictionary InvertedPendulumRobot_data.sldd

psi0 = Simulink.Parameter(10, Unit="deg")  % 初期psi
SimEndTime = Simulink.Parameter(30, Unit="s")  % シミュレーション終了時間
controller_config = Simulink.ConfigSet(StartTime="0", StopTime="100", FixedStep="TimeStep", Solver="FixedStepDiscrete", ProdHWDeviceType="Intel->x86-64 (Windows64)", SystemTargetFile="ert.tlc", TargetLang="C")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
controller_config_PIL = Simulink.ConfigSet(StartTime="0", StopTime="100", FixedStep="TimeStep", Solver="FixedStepDiscrete", ProdHWDeviceType="ARM Compatible->ARM Cortex", SystemTargetFile="ert.tlc", HardwareBoard="STM32 Nucleo H743ZI2", TargetLang="C")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
system_config = Simulink.ConfigSet(StartTime="0", StopTime="SimEndTime", AbsTol="1e-3", MaxStep="1e-3", RelTol="1e-3", Solver="ode23t", ProdHWDeviceType="Intel->x86-64 (Windows64)", SystemTargetFile="ert.tlc", TargetLang="C")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
TimeStep = Simulink.Parameter(0.01, Unit="s")  % 制御のタイムステップ