% Simulink data dictionary sim_data_DCmotor_system.sldd

TimeStep = Simulink.Parameter(0.01, DataType="double", Unit="s")  % サンプリングタイムステップ
SimEndTime = Simulink.Parameter(10)
linear_controller_config = Simulink.ConfigSet(StartTime="0", StopTime="100", FixedStep="TimeStep", Solver="FixedStepDiscrete", ProdHWDeviceType="Intel->x86-64 (Windows64)", SystemTargetFile="ert.tlc", TargetLang="C")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
linear_controller_config_PIL = Simulink.ConfigSet(StartTime="0", StopTime="100", FixedStep="TimeStep", Solver="FixedStepDiscrete", ProdHWDeviceType="ARM Compatible->ARM Cortex", SystemTargetFile="ert.tlc", HardwareBoard="STM32 Nucleo F401RE", TargetLang="C")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
DCmotor_system_config = Simulink.ConfigSet(StartTime="0", StopTime="SimEndTime", RelTol="1e-3", Solver="VariableStepAuto", ProdHWDeviceType="Intel->x86-64 (Windows64)", SystemTargetFile="ert.tlc", TargetLang="C")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