% Simulink data dictionary sim_data_unstable_system.sldd

TimeStep = Simulink.Parameter(0.01, DataType="double", Unit="s")  % サンプリングタイムステップ
PID_P_gain = Simulink.Parameter(1, DataType="single")
PID_I_gain = Simulink.Parameter(0.07, DataType="single")
PID_D_gain = Simulink.Parameter(0, DataType="single")
PID_Upper_Limit = Simulink.Parameter(0.2, DataType="single")
PID_Lower_Limit = Simulink.Parameter(-0.2, DataType="single")
unstable_system_config = Simulink.ConfigSet(StartTime="0", StopTime="SimEndTime", RelTol="1e-3", Solver="VariableStepAuto", ProdHWDeviceType="Intel->x86-64 (Windows64)", SystemTargetFile="ert.tlc", TargetLang="C")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
linear_controller_config = Simulink.ConfigSet(StartTime="0", StopTime="100", FixedStep="TimeStep", Solver="FixedStepDiscrete", ProdHWDeviceType="Intel->x86-64 (Windows64)", SystemTargetFile="ert.tlc", TargetLang="C")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
linear_controller_config_PIL = Simulink.ConfigSet(StartTime="0", StopTime="100", FixedStep="TimeStep", Solver="FixedStepDiscrete", ProdHWDeviceType="ARM Compatible->ARM Cortex", SystemTargetFile="ert.tlc", HardwareBoard="STM32 Nucleo F401RE", TargetLang="C")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
SimEndTime = Simulink.Parameter(60)