% Simulink data dictionary sim_data_vehicle.sldd

TimeStep = Simulink.Parameter(0.02, DataType="double", Unit="s")
div_min_MPC = Simulink.Parameter(0.001)

BUS_constraint = Simulink.Bus()
  x_max: double
  x_min: double
  y_max: double
  y_min: double

vehicle_config = Simulink.ConfigSet(StartTime="0", StopTime="SimEndTime", RelTol="1e-3", Solver="VariableStepAuto", ProdHWDeviceType="Intel->x86-64 (Windows64)", SystemTargetFile="ert.tlc", TargetLang="C")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
controller_config = Simulink.ConfigSet(StartTime="0", StopTime="100", FixedStep="TimeStep", Solver="FixedStepDiscrete", ProdHWDeviceType="Intel->x86-64 (Windows64)", SystemTargetFile="ert.tlc", TargetLang="C")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
controller_config_PIL = Simulink.ConfigSet(StartTime="0", StopTime="100", FixedStep="TimeStep", Solver="FixedStepDiscrete", ProdHWDeviceType="ARM Compatible->ARM Cortex", SystemTargetFile="ert.tlc", HardwareBoard="STM32 Nucleo F401RE", TargetLang="C")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
SimEndTime = Simulink.Parameter(110)