% Simulink data dictionary sim_data_vehicle_nl.sldd

div_min_MPC = Simulink.Parameter(0.001)
TimeStep = Simulink.Parameter(0.1, DataType="double", Unit="s")

NLMPC_param_bus = Simulink.Bus()
  wb: double  % ホイールベース
  ts: double

SimEndTime = Simulink.Parameter(70)
vehicle_nl_controller_config = Simulink.ConfigSet(StartTime="0", StopTime="SimEndTime", FixedStep="TimeStep", Solver="FixedStepDiscrete", ProdHWDeviceType="Intel->x86-64 (Windows64)", SystemTargetFile="ert.tlc", TargetLang="C")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
vehicle_nl_system_config = Simulink.ConfigSet(StartTime="0", StopTime="SimEndTime", RelTol="1e-3", Solver="VariableStepAuto", ProdHWDeviceType="Intel->x86-64 (Windows64)", SystemTargetFile="ert.tlc", TargetLang="C")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
vehicle_nl_controller_config_PIL = Simulink.ConfigSet(StartTime="0", StopTime="SimEndTime", FixedStep="TimeStep", Solver="FixedStepDiscrete", ProdHWDeviceType="ARM Compatible->ARM Cortex", SystemTargetFile="ert.tlc", HardwareBoard="Raspberry Pi", TargetLang="C")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
NLMPC_Hp = Simulink.Parameter(10)
refNum = Simulink.Parameter(10)
plant_ts = Simulink.Parameter(Simulink.data.Expression(ExpressionString="TimeStep"))