% Simulink data dictionary obstacleAvoidance_data.sldd

BusActors1 = Simulink.Bus()
  NumActors: double
  Time: double
  Actors: Bus: BusActors1Actors

BusActors1Actors = Simulink.Bus()
  ActorID: double
  Position: double[1 3]
  Velocity: double[1 3]
  Roll: double
  Pitch: double
  Yaw: double
  AngularVelocity: double[1 3]

BusObjectDetections1 = Simulink.Bus()
  NumDetections: double
  IsValidTime: boolean
  Detections: Bus: BusObjectDetections1Detections

BusObjectDetections1Detections = Simulink.Bus()
  Time: double
  Measurement: double[6 1]
  MeasurementNoise: double[6 6]
  SensorIndex: double
  ObjectClassID: double
  ObjectAttributes: Bus: BusObjectDetections1DetectionsObjectAttributes
  MeasurementParameters: Bus: BusObjectDetections1DetectionsMeasurementParameters

BusObjectDetections1DetectionsMeasurementParameters = Simulink.Bus()
  Frame: Enum: drivingCoordinateFrameType
  OriginPosition: double[3 1]
  Orientation: double[3 3]
  HasVelocity: boolean

BusObjectDetections1DetectionsObjectAttributes = Simulink.Bus()
  TargetIndex: double

TimeStep = Simulink.Parameter(0.02)
obstacleAvoid_controller = Simulink.ConfigSet(StartTime="0", StopTime="10", FixedStep="TimeStep", Solver="FixedStepDiscrete", ProdHWDeviceType="Intel->x86-64 (Windows64)", SystemTargetFile="ert.tlc", TargetLang="C")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
obstacleAvoid_controller_PIL = Simulink.ConfigSet(StartTime="0", StopTime="10", FixedStep="TimeStep", Solver="FixedStepDiscrete", ProdHWDeviceType="ARM Compatible->ARM Cortex", SystemTargetFile="ert.tlc", HardwareBoard="STM32 Nucleo H743ZI2", TargetLang="C")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